# Dynamo graph 神经网路预测.dyn (Dynamo 2.0.0.5801)

file_path = Filename("E:\VisualStudio\Expressior\data\optimized_graph.pb")
file_path_2 = Filename("E:\VisualStudio\Expressior\data\output_labels.txt")
file_path_3 = Filename("E:\VisualStudio\Expressior\data\flower.png")
predict = DeepLearning.Example.Predict(ModelFile=file_path, LabelFile=file_path_2, inputFile=file_path_3)
string = StringInput("sdf \n")
watch = Watch(string)
