# Dynamo custom node F.dyf (Dynamo 2.0.0.5801)
# category: CustomNode

scopeIf = ScopedIf()  # unwired: test, true, false
xor = Math.Xor()  # unwired: a, b
loopWhile = LoopWhile(init=scopeIf, loopBody=xor)  # unwired: continueWhile
