# Dynamo graph Agent.dyn (Dynamo 2.0.0.5801)

integer_slider = IntegerSlider(27, range=0..100 step 1)
integer_slider_2 = IntegerSlider(22, range=0..100 step 1)
integer_slider_3 = IntegerSlider(12, range=0..100 step 1)
modelAgent = AnalyzerModel(Model_File=integer_slider, Label_File=integer_slider_2, Input_File=integer_slider_3)
watch = Watch(modelAgent)
