# Dynamo graph 四项处理.dyn

file_path = Filename("G:\TCIA_LIDC-IDRI\LIDC-IDRI-Sample\LIDC-IDRI-0001\1.3.6.1.4.1.14519.5.2.1.6279.6001.298806137288633453246975630178\1.3.6.1.4.1.14519.5.2.1.6279.6001.179049373636438705059720603192\000061.dcm")
readDicomFromPath = DicomTools.DicomReader.ReadDicomFromPath(filepath=file_path)
matToBitmap = ImageProc.Converter.MatToBitmap(mat=readDicomFromPath)
watch_image = WatchImageCore(image=matToBitmap)
number_slider = DoubleSlider(52.2, range=0..100 step 0.1)
boolean = BoolSelector(true)
binnary = ImageProc.Processor.Binnary(inMat=readDicomFromPath, Threshold=number_slider, reverse=boolean)
matToBitmap_2 = ImageProc.Converter.MatToBitmap(mat=binnary)
watch_image_2 = WatchImageCore(image=matToBitmap_2)
color_palette = ColorPalette(DsColor={Red: 0, Green: 0, Blue: 0, Alpha: 255})
clearBorder = ImageProc.Processor.ClearBorder(inMat=binnary, color=color_palette)
sobel = ImageProc.Processor.Sobel(mat=clearBorder)
matToBitmap_3 = ImageProc.Converter.MatToBitmap(mat=sobel)
watch_image_3 = WatchImageCore(image=matToBitmap_3)
file_path_2 = Filename("F:\binnary322.png")
matToBitmap_4 = ImageProc.Converter.MatToBitmap(mat=clearBorder)
watch_image_4 = WatchImageCore(image=matToBitmap_4)
writeToFile = Image.WriteToFile(path=file_path_2, image=watch_image_4)
