# Dynamo graph 目标确定.dyn (Dynamo 2.0.0.5801)

file_path = Filename("..\..\..\data\IMG-0003-00001.dcm")
readDicomFromPath = DicomTools.DicomReader.ReadDicomFromPath(filepath=file_path)
number_slider = DoubleSlider(50.4, range=0..100 step 0.1)  # graph input
boolean = BoolSelector(true)  # graph input
binnary = ImageProc.Processor.Binnary(inMat=readDicomFromPath, Threshold=number_slider, reverse=boolean)
color_palette = ColorPalette({R: 0, G: 0, B: 0, A: 255})
clearBorder = ImageProc.Processor.ClearBorder(inMat=binnary, color=color_palette.out0)
integer_slider = IntegerSlider(3, range=0..100 step 1)  # graph input
erode = ImageProc.Processor.Erode(inMat=clearBorder, Size=integer_slider)
integer_slider_2 = IntegerSlider(10, range=0..100 step 1)  # graph input
close = ImageProc.Processor.Close(inMat=erode, Size=integer_slider_2)
integer_slider_3 = IntegerSlider(0, range=0..100 step 1)  # graph input
maxRegion = ImageProc.Processor.MaxRegion(inMat=close, Num=integer_slider_3)
matToBitmap = ImageProc.Converter.MatToBitmap(mat=maxRegion)
watch_image = WatchImageCore(image=matToBitmap)
matToBitmap_2 = ImageProc.Converter.MatToBitmap(mat=readDicomFromPath)
watch_image_2 = WatchImageCore(image=matToBitmap_2)
